# Grasshopper definition AEC Hackathon - get set render properties.gh (Grasshopper 0.9.76)
# plug-ins: Python Interpreter, treesloth01, StenoTool, Human

# GROUP TITLE  (CAPS)
# Subtitle
core_items = Number(0)
# 1
important_items = Number(0)

# ----
# TITLE
# CREATED BY: NAME
# Description: Input script description here:
# Quick Links
# Script Organization Best Practice
# Required: 1: Label big and often (60pt)
# 2: Highlight user controls and key items (red)
# 3: Number step-by-step instructions
# Recommended: 4: Group and label everything
# 5: Use pass-through containers to clarify inputs and outputs
stuck_ask_the_community = Button()
script_catalog = Button()
computation_sharepoint = Button()
x = PythonScript(x=stuck_ask_the_community)
# ---------- x: Python ----------
import webbrowser as wb
if x:
    url = 'https://teams.microsoft.com/l/team/19%3a6a1e90c69a6348c1a573aab0d4ad7d2e%40thread.skype/conversations?groupId=d6666e79-b216-41f0-9b42-1572b2b07b55&tenantId=a419c82f-5cb0-476b-a479-91ae8a7269f8'
    wb.open(url,2,True)
    print 'Happy downloading!'
else:
    print 'Set download to true...'
# ---------- end x ----------
x_2 = PythonScript(x=script_catalog)
# ---------- x_2: Python ----------
import webbrowser as wb
if x:
    url = 'http://sp.smithgroupjjr.com/disciplines/TIP/C/ScriptsViewer.aspx'
    wb.open(url,2,True)
    print 'Happy downloading!'
else:
    print 'Set download to true...'
# ---------- end x_2 ----------
x_3 = PythonScript(x=computation_sharepoint)
# ---------- x_3: Python ----------
import webbrowser as wb
if x:
    url = 'http://sp.smithgroupjjr.com/disciplines/TIP/C/default.aspx'
    wb.open(url,2,True)
    print 'Happy downloading!'
else:
    print 'Set download to true...'
# ---------- end x_3 ----------

# ----
# GET VIEWPORT ATTRIBUTES
button = Button()
# GET LIGHT DISTANCE FEATURE
scene_objects = Brep(<brep referenced from the Rhino model>)
# GET LIGHT ATTRIBUTES
panel = Panel("Light")
# GET REFLECTING SURFACES
scene_objects_2 = Brep(<brep referenced from the Rhino model>)
dpipeline = DynamicGeometryPipeline(
    LayerFilter="*",
    TypeFilter=panel,
    NameFilter="*",
    enableFullPath=False,
    GroupByLayer=False,
    GroupByType=False,
    IncludeHidden=True,
    IncludeLocked=True,
    listenToAttributes=True)
rec = Rectangle(scene_objects_2)
viewports = ViewportProperties(Update=button, AutoUpdate=False)  # -> ViewportNames, ActiveViewportIndex, ViewportBounds, ViewportDisplayMode, CameraLocation, CameraTarget, CameraPlane, CameraLensLength, CameraProjection, CameraUp
drec = DeconstuctRectangle(Rectangle=rec)  # -> BasePlane, XInterval, YInterval
lightprops = LightProperties(Light=dpipeline)  # -> Location, Direction, LightStyle, Intensity, Color, Attributes
brep_cp = BrepClosestPoint(Point=lightprops.Location, Brep=scene_objects)  # -> Point, Distance
names = Panel("""ReflectorPanelPlane
ReflectorPanelX
ReflectorPanelY""")
light_distance_from_object = Number(brep_cp.Distance)
entwine = Entwine(
    Branch00=viewports.ViewportBounds,
    Branch01=viewports.CameraLocation,
    Branch02=viewports.CameraTarget,
    Branch03=viewports.CameraPlane,
    Branch04=viewports.CameraLensLength,
    Branch05=viewports.CameraProjection,
    Branch06=viewports.CameraUp,
    FlattenInputs=True)  # -> simplify(Result)
entwine_2 = Entwine(Branch00=drec.BasePlane, Branch01=drec.XInterval, Branch02=drec.YInterval, FlattenInputs=True)
entwine_3 = Entwine(
    Branch00=lightprops.Location,
    Branch01=lightprops.Direction,
    Branch02=lightprops.LightStyle,
    Branch03=lightprops.Intensity,
    Branch04=lightprops.Color,
    Branch05=light_distance_from_object,
    FlattenInputs=True)  # -> simplify(Result)
item = ListItem(List=entwine, Index=viewports.ActiveViewportIndex, Wrap=True)
concat = Concatenate(FragmentA=graft(names), FragmentB=entwine_2, JoinSeparator=":")  # -> simplify(Result)
names_2 = Panel("""LightLocation
LightDirection
LightStyle
LightIntensity
LightColor
LightDistance""")
names_3 = Panel("""Bounds
cLocation
cTarget
cPlane
cLensLength
cProjection
cUpVector""")
concat_2 = Concatenate(FragmentA=graft(names_3), FragmentB=item, JoinSeparator=":")
concat_3 = Concatenate(FragmentA=graft(names_2), FragmentB=entwine_3, JoinSeparator=":")
shift = ShiftPaths(Data=concat_2, Offset=-1)
merge = Merge(Data1=flatten(shift), Data2=flatten(concat), Data3=flatten(concat_3))
python = PythonScript(stringIn=merge)  # -> out, stringOut; inputs stringIn: list
# ---------- python: Python ----------
stringOut= ""
for x in stringIn:
    stringOut += "_" + x
# ---------- end python ----------
chars = Characters(Text=python.stringOut)  # -> Result, Unicode
split = SplitList(List=chars.Result, Index="1")  # -> ListA, ListB
join = TextJoin(Text=split.ListB)
data_out = Data(join)
data_out_2 = Data("Bounds:Rectangle (w=924.0, h=389.0)_cLocation:{392.558837, -332.150006, 282.297013}_cTarget:{10.388823, -2.261193, 25.057525}_cPlane:O(392.56,-332.15,282.30) Z(0.67,-0.58,0.45)_cLensLength:50.0_cProjection:True_cUpVector:{-0.343667,0.296653,0.891005}_ReflectorPanelPlane:O(52.07,-42.32,-2.34) Z(1.00,0.00,0.00)_ReflectorPanelX:0.0 To 101.973997_ReflectorPanelY:0.0 To 43.779412_LightLocation:{-46.875977, 34.851574, 20.996304}_LightLocation:{30.06768, 29.235249, 20.71257}_LightLocation:{-10.089046, -43.496164, 36.317931}_LightDirection:{0.0,0.0,-1.0}_LightDirection:{0.0,0.0,-1.0}_LightDirection:{0.0,0.0,-1.0}_LightStyle:WorldPoint_LightStyle:WorldPoint_LightStyle:WorldPoint_LightIntensity:1.0_LightIntensity:1.0_LightIntensity:1.0_LightColor:255,255,255_LightColor:255,255,255_LightColor:255,255,255_LightDistance:49.696217_LightDistance:33.387564_LightDistance:41.741234")
purr = Purr(
    RunTheNode=Button(),
    DataToEmbed=data_out,
    PathToTarget="C:\\Users\\lcurtis\\Desktop\\test\\",
    PathToSource="C:\\Users\\lcurtis\\Desktop\\test\\cat.jpg",
    Password="sneakyCat")
data = Data(data_out_2)
panel_2 = Panel(purr)
button_2 = Button()
# WRANGLE ATTRIBUTES FROM STRING
panel_3 = Panel("_")
split_2 = TextSplit(Text=data, Separators=panel_3)
hiss = Hiss(RunTheNode=Toggle(True), PathToSource="C:\\Users\\lcurtis\\Desktop\\test\\876.jpg", Password="sneakyCat")
split_3 = TextSplit(Text=split_2, Separators=":")  # -> simplify(Result)
panel_4 = Panel(hiss)
item_2 = ListItem(List=split_3, Index="1", Wrap=True)  # -> Item, Item1
shift_2 = ShiftPaths(Data=item_2.Item, Offset=-1)
shift_3 = ShiftPaths(Data=item_2.Item1, Offset=-1)
names_4 = Panel("""ReflectorPanelPlane
ReflectorPanelX
ReflectorPanelY""")
names_5 = Panel("""LightLocation
LightDirection
LightStyle
LightIntensity
LightColor
LightDistance""")
names_6 = Panel("""cLocation
cTarget
cUpVector""")
names_7 = Panel("""Bounds
cPlane
cLensLength
cProjection""")
mindex = MemberIndex(Set=shift_3, Member=names_6)  # -> simplify(flatten(Index)), Count
mindex_2 = MemberIndex(Set=shift_3, Member=names_5)  # -> simplify(flatten(Index)), Count
mindex_3 = MemberIndex(Set=shift_3, Member=names_7)  # -> simplify(flatten(Index)), Count
mindex_4 = MemberIndex(Set=shift_3, Member=names_4)  # -> simplify(flatten(Index)), Count
captureview = Ladybug_CaptureView(fileName="AEC screenshot", folder="C:\Users\lcurtis\Desktop\test", imageWidth="2000", capture=Button())  # -> imagePath; plug-in component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
item_3 = ListItem(List=shift_2, Index=mindex_2.Index, Wrap=True)
item_4 = ListItem(List=shift_2, Index=mindex_3.Index, Wrap=True)
item_5 = ListItem(List=shift_2, Index=mindex_4.Index, Wrap=True)
item_6 = ListItem(List=shift_2, Index=mindex.Index, Wrap=True)
item_7 = ListItem(List=item_4, Index=0, Wrap=True)  # -> Item, Item1, Item2, Item3
lng = ListLength(List=names_5)
lng_2 = ListLength(List=item_3)
lng_3 = ListLength(List=names_4)
lng_4 = ListLength(List=item_5)
panel_5 = Panel("d")
rep = ReplaceText(Text=item_6, Find="{", Replace=" ", RecursiveReplace=False)
division = Division(A=lng_2, B=lng)
division_2 = Division(A=lng_4, B=lng_3)
partition = PartitionList(List=item_3, Size=division)
partition_2 = PartitionList(List=item_5, Size=division_2)
rep_2 = ReplaceText(Text=rep, Find="}", Replace=" ", RecursiveReplace=False)
flip = FlipMatrix(Data=partition)  # -> simplify(Data)
flip_2 = FlipMatrix(Data=partition_2)  # -> simplify(Data)
item_8 = ListItem(List=rep_2, Index=0, Wrap=True)  # -> Item, Item1, Item2
item_9 = ListItem(List=flip, Index=0, Wrap=True)  # -> Item, Item1, Item2, Item3, Item4, Item5
item_10 = ListItem(List=flip_2, Index=0, Wrap=True)  # -> Item, Item1, Item2
mod_viewport = ModifyViewport(
    CameraLocation=item_8.Item,
    CameraTarget=item_8.Item1,
    CameraProjection=item_7.Item3,
    CameraLensLength=item_7.Item2,
    CameraUp=item_8.Item2,
    AnimateRestore=False,
    RestoreFrames=10)
split_4 = TextSplit(Text=item_10.Item, Separators=" ")
createlight = CreateLight(
    Bake=Toggle(False),
    Location=item_9.Item,
    Direction=item_9.Item1,
    LightStyle=item_9.Item2,
    Intensity=item_9.Item3,
    Color=item_9.Item4)
split_5 = TextSplit(Text=split_4, Separators="(")
item_11 = ListItem(List=split_5, Index=0, Wrap=True)  # -> Item, Item1
split_6 = TextSplit(Text=item_11.Item1, Separators=")")
item_12 = ListItem(List=split_6, Index=0, Wrap=True)  # -> Item, Item1
clean = CleanTree(RemoveNulls=True, RemoveInvalid=True, RemoveEmpty=True, Tree=item_12.Item)  # -> flatten(Tree)
partition_3 = PartitionList(List=clean, Size="2")  # -> simplify(Chunks)
item_13 = ListItem(List=partition_3, Index=0, Wrap=True)  # -> Item, Item1
pl = PlaneNormal(Origin=item_13.Item, ZAxis=item_13.Item1)
rectangle = Rectangle(Plane=pl, XSize=item_10.Item1, YSize=item_10.Item2, Radius=0)  # -> Rectangle, Length
boundary = BoundarySurfaces(Edges=rectangle.Rectangle)
